# Grasshopper definition box_plot_example_share.gh (Grasshopper 1.0.7)
# plug-ins: Hops

# PABLO ARANGO
# Computational Developer / Environmental Designer
# https://www.linkedin.com/in/monsieurpablo/
# Seaborn-gh based on the initial release of Hops_plots by Maes Antoine
# 
# Connects Grasshopper with a CPython web server to utilize Seaborn and Matplotlib.
# 
# The server is running on a free dyno, so it might not be available in the future.
panel = Panel("https://seaborn-gh.herokuapp.com/")
# Select City!
# Sample Data Contains
# the following columns
# - hour
# - season
# - drybulb
# - direct_normal_radiation
list = ValueList({"LONDON": 0, "NEW_YORK": 1, "SYDNEY": 2, "MEDELLIN": 3, "BERLIN": 4}, selected="BERLIN")
# Select plot type
list_2 = ValueList({"catplot", "stripplot", "swarmplot", "boxplot", "violinplot", "boxenplot", "pointplot", "barplot", "countplot", "displot", "histplot", "kdeplot", "lineplot", "relplot", "scatterplot"}, selected="histplot")
cluster = Cluster(city=list)
# Select plot type
list_3 = ValueList({"catplot", "stripplot", "swarmplot", "boxplot", "violinplot", "boxenplot", "pointplot", "barplot", "countplot", "displot", "histplot", "kdeplot", "lineplot", "relplot", "scatterplot"}, selected="boxplot")
concat = Concatenate(FragmentA=panel, FragmentB=list_2)
hops = Hops(
    _Path=concat,
    Dataframe=cluster,
    XAxis="drybulb",
    Hue="season",
    Stat="frequency",
    Cumulative=False,
    Multiple="layer",
    Element="bars",
    Fill=True,
    Shrink=1,
    KDE=False,
    Legend=True,
    Palette="deep",
    Plot=Toggle(True),
    CacheResultsInMemory=False,
    CacheSolveResults=True,
    RemoteDefinitionLocation="https://seaborn-gh.herokuapp.com/histplot",
    RemoteSolveVersion=(0, 1, 0),
    ShowInput_Enabled=False,
    ShowInput_Path=True,
    SynchronousSolve=True)
concat_2 = Concatenate(FragmentA=panel, FragmentB=list_3)
hops_2 = Hops(
    _Path=concat_2,
    Dataframe=cluster,
    XAxis="season",
    YAxis="drybulb",
    Palette="deep",
    Plot=Toggle(True),
    CacheResultsInMemory=False,
    CacheSolveResults=True,
    RemoteDefinitionLocation="https://seaborn-gh.herokuapp.com/boxplot",
    RemoteSolveVersion=(0, 1, 0),
    ShowInput_Enabled=False,
    ShowInput_Path=True,
    SynchronousSolve=True)
str2img = GhPythonScript(img_str=hops, file_name="hist.png", run=Toggle(True))  # -> full_path; inputs run: Boolean
# ---------- str2img: Python ----------
__author__ = "pablo"
__version__ = "2022.09.01"

import os

current_folder = os.path.dirname(ghenv.Component.OnPingDocument().FilePath)
folder = folder_ if folder_ else current_folder
full_path = os.path.join(folder, file_name) 

if _run:
    # or, more concisely using with statement
    with open(full_path, "wb") as fh:
        fh.write(img_str.decode('base64'))
# ---------- end str2img ----------
rec = Rectangle({Plane=PlaneXY(328.7539267, 529.8010471, 0), Size=Domain2(u=-252.0209424..252.0209424, v=-201.3403141..201.3403141)})
rec_2 = Rectangle({Plane=PlaneXY(328.7539267, 112.3769634, 0), Size=Domain2(u=-252.0209424..252.0209424, v=-201.3403141..201.3403141)})
str2img_2 = GhPythonScript(img_str=hops_2, file_name="box_plot.png", run=Toggle(True))  # -> full_path; inputs run: Boolean; same code as str2img
img = ImportImage(File=str2img_2, Rectangle=rec_2)
img_2 = ImportImage(File=str2img, Rectangle=rec)

# ==== cluster Cluster
city = ClusterInput()
new_york = Text("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")
london = Text("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")
sydney = Text("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")
medellin = Text("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")
berlin = Text("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")
merge = Merge(Data1=london, Data2=new_york, Data3=sydney, Data4=medellin, Data5=berlin)
city_2 = Integer(city)
item = ListItem(List=merge, Index=city_2, Wrap=True)
sample_csv_data = Text(item)
sample_csv_data_2 = ClusterOutput(sample_csv_data)
