# Grasshopper definition figure_charts_share.gh (Grasshopper 1.0.7)
# plug-ins: Hops, Human, Telepathy, MetaHopper

# ----
# Server: https://seaborn-grasshopper.onrender.com/
# Data is a csv format with a '@' as line terminator
# Common Axis Arguments: title(str)
# xlabel(str)
# ylabel(str)
# xticks(tick)
# yticks(ticks)
# grid(bool)
# xlim([min, max])
# ylim([min, max])
# xscale(str): (e.g., 'linear' or 'log')
# yscale(str): (e.g., 'linear' or 'log')
panel = Panel("example-weather-data.csv")
relpath = RelativePath(Path=panel)
file = ReadFile(File=relpath, PerLineParse=True)
json_format = Panel("{\"title\" : \"My Custom Title\", \"xlabel\" : \"X label\" , \"ylabel\" : \"Y label\", \"xlim\" : [-10, 35], \"xticks\" : [-10, 0, 10, 20 , 30]}")
dev_server = Panel("https://seaborn-grasshopper-dev.onrender.com/")
local_development = Panel("http://127.0.0.1:8000/")
item = ListItem(List=file, Index=0, Wrap=True)
join = TextJoin(Text=file, Join="@")
split = TextSplit(Text=item, Separators=",")
despine = GhPythonScript(top=Toggle(True), offset=Slider(5, range=0..10))  # -> despine; inputs top: Boolean, right: Boolean, left: Boolean, bottom: Boolean, trim: Boolean
# ---------- despine: Python ----------
import Grasshopper.Kernel.Data as ghp
import Grasshopper.DataTree as ghdt
import Grasshopper as gh
import json

def check_types(item):
    if str(item).isdigit():
        item = int(item)
    elif item.replace('.', '', 1).isdigit() and item.count('.') < 2:
        item = float(item)
    elif item == 'True' or item == 'true':
        item = True
    elif item == 'False' or item == 'false':
        item = False
    else:
        item = str(item)
    
    return item

names = []
values = []

for input in ghenv.Component.Params.Input:
    for s in input.Sources:
        names.append(input.Name)
        attr = s.Attributes
        if (attr is None) or (attr.GetTopLevel is None):
            pass
        else:
            component = attr.GetTopLevel.DocObject
#            print input.Name
#            print component.NickName
            if type(component) is gh.Kernel.Special.GH_NumberSlider:
#                print component.Slider.Value
                values.append(int(component.Slider.Value))
            elif type(component) is gh.Kernel.Special.GH_Panel:
#                print component.UserText
                values.append(component.UserText)
            elif type(component) is gh.Kernel.Special.GH_BooleanToggle:
#                print component.Value
                values.append(component.Value)
#            component.ExpireSolution(True)

print names
dict = {k:check_types(str(v)) for k,v in zip(names, values)}
print [type(v) for k,v in dict.items()]
print dict

despine = json.dumps(dict)
# ---------- end despine ----------
add_args = GhPythonScript(height="4", aspect="1.5")  # -> add_args
# ---------- add_args: Python ----------
import Grasshopper.Kernel.Data as ghp
import Grasshopper.DataTree as ghdt
import Grasshopper as gh
import json

names = []
values = []

def check_types(item):
    if str(item).isdigit():
        item = int(item)
    elif item.replace('.', '', 1).isdigit() and item.count('.') < 2:
        item = float(item)
    elif item == 'True' or item == 'true':
        item = True
    elif item == 'False' or item == 'false':
        item = False
    else:
        item = str(item)
    
    return item


for input in ghenv.Component.Params.Input:
    for s in input.Sources:
        names.append(input.Name)
        attr = s.Attributes
        if (attr is None) or (attr.GetTopLevel is None):
            pass
        else:
            component = attr.GetTopLevel.DocObject
#            print input.Name
#            print component.NickName
            if type(component) is gh.Kernel.Special.GH_NumberSlider:
#                print component.Slider.Value
                values.append(int(component.Slider.Value))
            elif type(component) is gh.Kernel.Special.GH_Panel:
#                print component.UserText
                values.append(component.UserText)
            elif type(component) is gh.Kernel.Special.GH_BooleanToggle:
#                print component.Value
                values.append(component.Value)
#            component.ExpireSolution(True)

print names

dict = {k:check_types(str(v)) for k,v in zip(names, values)}

print [type(v) for k,v in dict.items()]
print dict

add_args = json.dumps(dict)
# ---------- end add_args ----------
headers = Panel(split)
csv_str = Text(join)
fig_size = RemoteSender("10;5")
ax_args = RemoteSender(json_format)
despine_2 = RemoteSender(despine)
# PABLO ARANGO
# Computational Developer / Environmental Designer
# https://www.linkedin.com/in/monsieurpablo/
# https://github.com/monsieurpablo/seaborn_grasshopper
address = RemoteSender(dev_server)
data = RemoteSender(csv_str)

# ---- group: run.
toggle = BooleanToggle(True)

# ----
list = ValueList({"catplot", "stripplot", "swarmplot", "boxplot", "violinplot", "boxenplot", "pointplot", "barplot", "countplot", "displot", "histplot", "kdeplot", "lineplot", "relplot", "scatterplot", "pairplot", "jointplot"}, selected="catplot")

data_2 = Data()
data_3 = Data()

despine_3 = RemoteReceiver(despine_2)
address_2 = RemoteReceiver(address)
ax_args_2 = RemoteReceiver(ax_args)
fig_size_2 = RemoteReceiver(fig_size)
data_4 = RemoteReceiver(data)
concat = Concatenate(FragmentA=address_2, FragmentB=list)
hops = Hops(
    _Path=concat,
    Dataframe=data_4,
    XAxis="t_dry",
    YAxis="season",
    Col_wrap=-999,
    CoinfidenceInterval="None",
    Seed=2,
    Kind="violin",
    Palette="turbo",
    FigureSize=fig_size_2,
    Despine=despine_3,
    AdditionalArguments="{}",
    AxisArguments=ax_args_2,
    Plot=toggle,
    CacheResultsInMemory=False,
    CacheSolveResults=False,
    RemoteDefinitionLocation="https://seaborn-grasshopper-dev.onrender.com/catplot",
    RemoteSolveVersion=(0, 1, 0),
    ShowInput_Enabled=False,
    ShowInput_Path=True,
    SynchronousSolve=False)
str2img = DeserializeImageFromString(ImageString=hops)
image_resource = ImageResource(str2img)
list_2 = ValueList({"catplot", "stripplot", "swarmplot", "boxplot", "violinplot", "boxenplot", "pointplot", "barplot", "countplot", "displot", "histplot", "kdeplot", "lineplot", "relplot", "scatterplot", "pairplot", "jointplot"}, selected="relplot")
despine_4 = RemoteReceiver(despine_2)
address_3 = RemoteReceiver(address)
ax_args_3 = RemoteReceiver(ax_args)
fig_size_3 = RemoteReceiver(fig_size)
data_5 = RemoteReceiver(data)
concat_2 = Concatenate(FragmentA=address_3, FragmentB=list_2)
hops_2 = Hops(
    _Path=concat_2,
    Dataframe=data_5,
    XAxis="dir_norm_rad",
    YAxis="t_dry",
    Hue="season",
    Size="t_dry",
    Columns="season",
    Col_wrap="2",
    Kind="scatter",
    Palette="deep",
    FigureSize=fig_size_3,
    Despine=despine_4,
    AdditionalArguments="{}",
    AxisArguments=ax_args_3,
    Plot=Toggle(False),
    CacheResultsInMemory=False,
    CacheSolveResults=False,
    RemoteDefinitionLocation="https://seaborn-grasshopper-dev.onrender.com/relplot",
    RemoteSolveVersion=(0, 1, 0),
    ShowInput_Enabled=False,
    ShowInput_Path=True,
    SynchronousSolve=False)
str2img_2 = DeserializeImageFromString(ImageString=hops_2)
image_resource_2 = ImageResource(str2img_2)

# ---- group: run.
toggle_2 = BooleanToggle(False)

# ----
list_3 = ValueList({"catplot", "stripplot", "swarmplot", "boxplot", "violinplot", "boxenplot", "pointplot", "barplot", "countplot", "displot", "histplot", "kdeplot", "lineplot", "relplot", "scatterplot", "pairplot", "jointplot"}, selected="displot")
despine_5 = RemoteReceiver(despine_2)
address_4 = RemoteReceiver(address)
ax_args_4 = RemoteReceiver(ax_args)
fig_size_4 = RemoteReceiver(fig_size)
data_6 = RemoteReceiver(data)
concat_3 = Concatenate(FragmentA=address_4, FragmentB=list_3)
hops_3 = Hops(
    _Path=concat_3,
    Dataframe=data_6,
    XAxis="t_dry",
    Hue="season",
    Col_wrap=-999,
    Kind="kde",
    Rug=False,
    Legend=True,
    Palette="deep",
    FigureSize=fig_size_4,
    Despine=despine_5,
    AdditionalArguments="{}",
    AxisArguments=ax_args_4,
    Plot=toggle_2,
    CacheResultsInMemory=False,
    CacheSolveResults=False,
    RemoteDefinitionLocation="https://seaborn-grasshopper-dev.onrender.com/displot",
    RemoteSolveVersion=(0, 1, 0),
    ShowInput_Enabled=False,
    ShowInput_Path=True,
    SynchronousSolve=False)
str2img_3 = DeserializeImageFromString(ImageString=hops_3)
image_resource_3 = ImageResource(str2img_3)

# ---- group: run.
toggle_3 = BooleanToggle(False)

# ----
list_4 = ValueList({"catplot", "stripplot", "swarmplot", "boxplot", "violinplot", "boxenplot", "pointplot", "barplot", "countplot", "displot", "histplot", "kdeplot", "lineplot", "relplot", "scatterplot", "pairplot", "jointplot"}, selected="jointplot")
despine_6 = RemoteReceiver(despine_2)
address_5 = RemoteReceiver(address)
ax_args_5 = RemoteReceiver(ax_args)
fig_size_5 = RemoteReceiver(fig_size)
data_7 = RemoteReceiver(data)
concat_4 = Concatenate(FragmentA=address_5, FragmentB=list_4)
hops_4 = Hops(
    _Path=concat_4,
    Dataframe=data_7,
    XAxis="t_dry",
    YAxis="wind_speed",
    Kind="hex",
    Palette="deep",
    Despine=despine_6,
    AdditionalArguments="{}",
    AxisArguments="{}",
    Plot=toggle_3,
    CacheResultsInMemory=False,
    CacheSolveResults=False,
    RemoteDefinitionLocation="https://seaborn-grasshopper-dev.onrender.com/jointplot",
    RemoteSolveVersion=(0, 1, 0),
    ShowInput_Enabled=False,
    ShowInput_Path=True,
    SynchronousSolve=False)
str2img_4 = DeserializeImageFromString(ImageString=hops_4)
image_resource_4 = ImageResource(str2img_4)

# ----
# CATEGORICAL
# RELATIONAL
# DISTRIBUTION
# JOINT PLOT
# FIGURE
# LEVEL
data_8 = Data()
